# Grasshopper definition REG_Redefine Point Order.gh (Grasshopper 1.0.7)
# plug-ins: LunchBox, EleFront, Pufferfish, treesloth01, eleFront

crv = Curve([<curve referenced from the Rhino model> x85])
brep = Brep([<brep referenced from the Rhino model> x261])
tsel = ToggleSelection(toggle=Toggle(True), id=brep)
disc = Discontinuity(Curve=brep, Level=1)  # -> Points, Parameters
panel = Panel("""N
E
S
W""")
crv_2 = Curve(<curve referenced from the Rhino model>)
brep_2 = Brep(<brep referenced from the Rhino model>)
lng = ListLength(List=disc.Points)  # -> flatten(Length)
cset = CreateSet(List=lng)  # -> Set, Map
filteratt_r6 = FilterByUserAttributesR6(Attributes=crv, Key="Facing", Val=panel)  # -> simplify(Crv), Key, Val
brep_3 = Brep(<brep referenced from the Rhino model>)
sort = SortList(Keys=cset.Set)  # -> Keys, ValuesA
end = EndPoints(Curve=crv_2)  # -> Start, End
pcen = PolygonCenter(Polyline=brep_3)  # -> CenterV, CenterE, CenterA
panel_2 = Panel(lng)
boundary = BoundarySurfaces(Edges=brep_3)
txt = Text(sort.Keys)
txt_2 = Text(lng)
merge = Merge(Data1=end.Start, Data2=end.End)
debrep = DeconstructBrep(Brep=brep_3)  # -> Faces, Edges, Vertices
branch = TreeBranch(Tree=filteratt_r6.Crv, Path="0", MaintainPaths=True)
branch_2 = TreeBranch(Tree=filteratt_r6.Crv, Path="1", MaintainPaths=True)
branch_3 = TreeBranch(Tree=filteratt_r6.Crv, Path="2", MaintainPaths=True)
branch_4 = TreeBranch(Tree=filteratt_r6.Crv, Path="3", MaintainPaths=True)
mindex = MemberIndex(Set=txt_2, Member=txt)  # -> Index, Count
points = PointList(Points=merge, Size=Slider(10, range=0..10))
plcoord = PlaneCoordinates(System=PlaneXY(0, 0, 0))  # -> XCoordinate, YCoordinate, ZCoordinate
debrep_2 = DeconstructBrep(Brep=boundary)  # -> Faces, Edges, Vertices
points_2 = PointList(Points=debrep.Vertices, Size=Slider(10, range=0..10))
end_2 = EndPoints(Curve=branch)  # -> Start, End
end_3 = EndPoints(Curve=branch_2)  # -> Start, End
end_4 = EndPoints(Curve=branch_3)  # -> Start, End
end_5 = EndPoints(Curve=branch_4)  # -> Start, End
item = ListItem(List=brep, Index=mindex.Index, Wrap=True)
points_3 = PointList(Points=debrep_2.Vertices, Size=Slider(10, range=0..10))
brep_4 = Brep(<brep referenced from the Rhino model>)
evalsrf = EvaluateSurface(Surface=reparameterize(brep_4), Point="0.5,0.5")  # -> Point, Normal, UDirection, VDirection, Frame
circle = CircleCNR(Center=evalsrf.Frame, Normal=evalsrf.Frame, Radius=Slider(10, range=0..10))
bang = ExplodeTree(Data=item)  # -> Branch0, Branch1, Branch2, Branch3, Branch4, Branch5
merge_2 = Merge(Data1=graft(end_2.Start), Data2=graft(end_2.End))  # -> simplify(Result)
merge_3 = Merge(Data1=graft(end_3.Start), Data2=graft(end_3.End))  # -> simplify(Result)
merge_4 = Merge(Data1=graft(end_4.Start), Data2=graft(end_4.End))  # -> simplify(Result)
merge_5 = Merge(Data1=graft(end_5.Start), Data2=graft(end_5.End))  # -> simplify(Result)
flip = FlipCurve(Curve=circle)  # -> Curve, Flag
panel_3 = Panel(branch)
brep_5 = Brep(simplify(graft([<brep referenced from the Rhino model> x7])))
brep_6 = Brep(graft(bang.Branch0))
pdecon = Deconstruct(Point=merge_2)  # -> XComponent, YComponent, ZComponent
pdecon_2 = Deconstruct(Point=merge_4)  # -> XComponent, YComponent, ZComponent
pdecon_3 = Deconstruct(Point=merge_3)  # -> XComponent, YComponent, ZComponent
pdecon_4 = Deconstruct(Point=merge_5)  # -> XComponent, YComponent, ZComponent
flip_2 = FlipCurve(Curve=brep_4, Guide=flip.Curve)  # -> Curve, Flag
toggle = BooleanToggle(True)
brep_7 = Brep(brep_5)
neg = Negative(Value=pdecon_2.YComponent)
neg_2 = Negative(Value=pdecon_4.XComponent)
debrep_3 = DeconstructBrep(Brep=brep_4)  # -> Faces, Edges, Vertices
debrep_4 = DeconstructBrep(Brep=brep_7)  # -> simplify(graft(Faces)), Edges, Vertices
disc_2 = Discontinuity(Curve=flip_2.Curve, Level=1)  # -> Points, Parameters
roundd = RoundToDecimalPlace(NumberX=pdecon_3.XComponent, DecimalPlace=3, RoundType=0)  # -> Rounded, Difference
roundd_2 = RoundToDecimalPlace(NumberX=neg, DecimalPlace=3, RoundType=0)  # -> Rounded, Difference
roundd_3 = RoundToDecimalPlace(NumberX=neg_2, DecimalPlace=3, RoundType=0)  # -> Rounded, Difference
roundd_4 = RoundToDecimalPlace(NumberX=pdecon.YComponent, DecimalPlace=3, RoundType=0)  # -> Rounded, Difference
area = Area(Geometry=brep_7)  # -> Area, Centroid
area_2 = Area(Geometry=debrep_4.Faces)  # -> Area, Centroid
shift = ShiftList(List=disc_2.Points, Shift=Slider(0, range=0..100), Wrap=toggle)
sort_2 = SortList(Keys=roundd_4.Rounded, ValuesA=merge_2)  # -> Keys, ValuesA
sort_3 = SortList(Keys=roundd.Rounded, ValuesA=merge_3)  # -> Keys, ValuesA
sort_4 = SortList(Keys=roundd_2.Rounded, ValuesA=merge_4)  # -> Keys, ValuesA
sort_5 = SortList(Keys=roundd_3.Rounded, ValuesA=merge_5)  # -> Keys, ValuesA
panel_4 = Panel(disc_2.Points)
cps = ClosestPoints(Point=area.Centroid, Cloud=debrep_4.Vertices, Count="99")  # -> ClosestPoint, CPIndex, simplify(Distance)
srf_cp = SurfaceClosestPoint(Point=area_2.Centroid, Surface=debrep_4.Faces)  # -> Point, UVPoint, Distance
points_4 = PointList(Points=shift, Size=Slider(50, range=0..100))
item_2 = ListItem(List=sort_2.ValuesA, Index=0, Wrap=True)  # -> Item, Item1
item_3 = ListItem(List=sort_3.ValuesA, Index=0, Wrap=True)  # -> Item, Item1
item_4 = ListItem(List=sort_4.ValuesA, Index=0, Wrap=True)  # -> Item, Item1
item_5 = ListItem(List=sort_5.ValuesA, Index=0, Wrap=True)  # -> Item, Item1
sort_6 = SortList(Keys=cps.Distance, ValuesA=cps.ClosestPoint)  # -> reverse(Keys), reverse(ValuesA)
evalsrf_2 = EvaluateSurface(Surface=debrep_4.Faces, Point=srf_cp.UVPoint)  # -> Point, Normal, UDirection, VDirection, Frame
ln = Line(StartPoint=item_2.Item, EndPoint=item_2.Item1)
ln_2 = Line(StartPoint=item_3.Item, EndPoint=item_3.Item1)
ln_3 = Line(StartPoint=item_4.Item, EndPoint=item_4.Item1)
ln_4 = Line(StartPoint=item_5.Item, EndPoint=item_5.Item1)
split = SplitList(List=sort_6.ValuesA, Index="4")  # -> simplify(ListA), ListB
shift_2 = ShiftPaths(Data=evalsrf_2.Normal, Offset=-1)
pline = PolyLine(Vertices=shift, Closed=toggle)
getatt_r6 = GetElefrontAttributesR6(Geometry=branch)  # -> simplify(graft(Attributes))
getatt_r6_2 = GetElefrontAttributesR6(Geometry=branch_2)  # -> simplify(graft(Attributes))
getatt_r6_3 = GetElefrontAttributesR6(Geometry=branch_3)  # -> simplify(graft(Attributes))
getatt_r6_4 = GetElefrontAttributesR6(Geometry=branch_4)  # -> simplify(graft(Attributes))
data = Data(split.ListA)
disc_3 = Discontinuity(Curve=pline, Level=1)  # -> Points, Parameters
flip_3 = FlipCurve(Curve=pline)  # -> Curve, Flag
pdecon_5 = Deconstruct(Point=data)  # -> XComponent, YComponent, ZComponent
sort_7 = SortList(Keys=pdecon_5.ZComponent, ValuesA=data)  # -> Keys, ValuesA
points_5 = PointList(Points=disc_3.Points, Size=Slider(50, range=0..100))
item_6 = ListItem(List=sort_7.ValuesA, Index=0, Wrap=True)  # -> Item, Item1
boundary_2 = BoundarySurfaces(Edges=flip_3.Curve)
bake_r6 = BakeObjectsR6(Geometry=ln, Attributes=getatt_r6, Bake=False)
bake_r6_2 = BakeObjectsR6(Geometry=ln_2, Attributes=getatt_r6_2, Bake=False)
bake_r6_3 = BakeObjectsR6(Geometry=ln_3, Attributes=getatt_r6_3, Bake=False)
ln_5 = Line(StartPoint=item_6.Item, EndPoint=item_6.Item1)
disc_4 = Discontinuity(Curve=boundary_2, Level=1)  # -> Points, Parameters
curvepoint = PointOnCurve(ln_5, parameter=0.5)
bake_r6_4 = BakeObjectsR6(Geometry=ln_4, Attributes=getatt_r6_4, Bake=False)
brep_8 = Brep(brep)
move = Move(Geometry=curvepoint, Motion=Vector(0, 0, 10))  # -> Geometry, Transform
points_6 = PointList(Points=disc_4.Points, Size=Slider(50, range=0..100))

debrep_5 = DeconstructBrep(Brep=brep_8)  # -> Faces, Edges, Vertices
points_7 = PointList(Points=debrep_5.Vertices, Size=Slider(3, range=0..10))

# ---- group: Select Bottom Curve for LCS Origin
debrep_6 = DeconstructBrep(Brep=brep_6)  # -> Faces, Edges, Vertices
curvepoint_2 = PointOnCurve(debrep_6.Edges, parameter=0.5)
pdecon_6 = Deconstruct(Point=curvepoint_2)  # -> XComponent, YComponent, ZComponent
sort_8 = SortList(Keys=pdecon_6.ZComponent, ValuesA=debrep_6.Edges)  # -> Keys, ValuesA
item_7 = ListItem(List=sort_8.ValuesA, Index=0, Wrap=True)  # -> Item, Item1, Item2, Item3
curvepoint_3 = PointOnCurve(item_7.Item, parameter=0.5)

# ---- group: Create Local Coordinate System
area_3 = Area(Geometry=brep_6)  # -> Area, Centroid
srf_cp_2 = SurfaceClosestPoint(Point=area_3.Centroid, Surface=brep_6)  # -> Point, UVPoint, Distance
evalsrf_3 = EvaluateSurface(Surface=brep_6, Point=srf_cp_2.UVPoint)  # -> Point, Normal, UDirection, VDirection, Frame
Z = UnitZ(Factor=1)
pi = Pi(Factor=".5")
vrot = Rotate(Vector=evalsrf_3.Normal, Axis=Z, Angle=pi)
rev = Reverse(Vector=vrot)
rev_2 = Reverse(Vector=Z)

# ----
panel_5 = Panel(evalsrf_3.Normal)

# ---- group: Select Bottom Curve for LCS Origin (continued)
move_2 = Move(Geometry=curvepoint_3, Motion=Z)  # -> Geometry, Transform

# ---- group: Create Local Coordinate System (continued)
pl = ConstructPlane(Origin=move_2.Geometry, XAxis=rev_2, YAxis=rev)

# ---- group: Sort Points with Guide Circle
disc_5 = Discontinuity(Curve=brep_6, Level=1)  # -> Points, Parameters
cir = Circle(Plane=pl, Radius=1)
crv_cp = CurveClosestPoint(Point=disc_5.Points, Curve=cir)  # -> Point, Parameter, Distance
sort_9 = SortList(Keys=crv_cp.Parameter, ValuesA=disc_5.Points)  # -> Keys, ValuesA

# ---- group: Create New Surfaces with Correct Point Order
item_8 = ListItem(List=sort_9.ValuesA, Index=0, Wrap=True)  # -> Item, Item1, Item2, Item3
srf4pt = _4PointSurface(CornerA=item_8.Item, CornerB=item_8.Item1, CornerC=item_8.Item2, CornerD=item_8.Item3)

# ---- group: Multi-Sided Srfs
item_9 = ListItem(List=sort_9.ValuesA, Index=0, Wrap=True)  # -> Item, Item1, Item2, Item3, Item4, Item5
merge_6 = Merge(Data1=item_9.Item, Data2=item_9.Item1, Data3=item_9.Item2, Data4=item_9.Item3, Data5=item_9.Item4, Data6=item_9.Item5)
pline_2 = PolyLine(Vertices=merge_6, Closed=Toggle(True))
boundary_3 = BoundarySurfaces(Edges=pline_2)
debrep_7 = DeconstructBrep(Brep=boundary_3)  # -> Faces, Edges, Vertices
points_8 = PointList(Points=debrep_7.Vertices, Size=Slider(10, range=0..10))

# ----
flip_4 = Flip(Surface=srf4pt)  # -> simplify(Surface), Result
panel_6 = Panel(flip_4.Surface)

# ---- group: Bake New Surfaces w Existing Attributes I
rhatt = GetRhinoAttributes(Geometry=brep_6, fullpath=False)  # -> simplify(Name), simplify(Layer), simplify(Color), MaterialName, SourceFile
getua = GetUserAttributes(Geometry=brep_6)  # -> simplify(Keys), simplify(Values), simplify(BakeName)
panel_7 = Panel("GH Object1")
bake = ObjectBake(
    BakeToggle=Button(),
    GeometryObjects=flip_4.Surface,
    Layer=rhatt.Layer,
    ObjectName=rhatt.Name,
    ObjectColor=rhatt.Color,
    LayerColor=rhatt.Color,
    UserString=getua.Values,
    UserKeys=getua.Keys)

# ==== cluster ToggleSelection

toggle = ClusterInput()
id = ClusterInput()

id_2 = Guid(id)
c_script = CSharpScript(toggle=toggle, guid=id_2)  # -> out, A; inputs toggle: Boolean, guid: Guid
# ---------- c_script: C# ----------
  if (toggle == true)
      doc.Objects.Select(guid, true);
  else
    doc.Objects.Select(guid, false);
# ---------- end c_script ----------
